# Grasshopper definition millingAssignment.gh (Grasshopper 0.9.76)
# plug-ins: Heteroptera, MeshEdit Components, Kangaroo Components

number_slider = Slider(2000, range=0..20000)
rectangle = Rectangle(Plane=PlaneXY(0, 0, 0), XSize=Slider(1220, range=0..10000), YSize=Slider(813, range=0..1000), Radius=0)  # -> Rectangle, Length
pop2d = Populate2D(Region=rectangle.Rectangle, Count=number_slider, Seed=Slider(1, range=0..30))
division = Division(A=number_slider, B=Slider(4.1, range=0..10))
popgeo = PopulateGeometry(Geometry=rectangle.Rectangle, Count=Slider(50, range=0..100), Seed=1)
image = ImageSampler(pop2d, FilePath="E:\insta\processing.jpg", Filter="Value", Interpolate=True, Umax=1220, Umin=0, Vmax=813, Vmin=0, Wrap=1)
sort = SortList(Keys=image, ValuesA=pop2d)  # -> Keys, ValuesA
split = SplitList(List=sort.ValuesA, Index=division)  # -> ListA, ListB
pt = Point(split.ListB)
split_2 = SplitList(List=pt, Index=division)  # -> ListA, ListB
division_2 = Division(A=division, B=Slider(1.4, range=0..10))
division_3 = Division(A=division, B=Slider(1.046, range=0..10))
division_4 = Division(A=division, B=Slider(0.92, range=0..10))
pt_2 = Point(split_2.ListA)
pt_3 = Point(split_2.ListB)
split_3 = SplitList(List=pt_3, Index=division)  # -> ListA, ListB
pt_4 = Point(split_3.ListA)
pt_5 = Point(split_3.ListB)
divide = DivideCurve(Curve=rectangle.Rectangle, Count=Slider(21, range=0..100), Kinks=False)  # -> Points, Tangents, Parameters
reduce = RandomReduce(List=pt_4, Reduction=division_3, Seed=Slider(3, range=0..30))
disc = Discontinuity(Curve=rectangle.Rectangle, Level=1)  # -> Points, Parameters
reduce_2 = RandomReduce(List=pt_2, Reduction=division_2, Seed=Slider(1, range=0..30))
reduce_3 = RandomReduce(List=pt_5, Reduction=division_4, Seed=Slider(0, range=0..30))
pt_6 = Point(split.ListA)
merge = Merge(Data1=pt_6, Data2=reduce_2, Data3=reduce, Data4=reduce_3, Data5=divide.Points, Data6=disc.Points, Data7=popgeo)  # -> flatten(Result)

duppt = RemoveDuplicatePts(Points=merge, Tolerance=0.01)
voronoi = Voronoi(Points=duppt, Boundary=rectangle.Rectangle, BruteForceOverride=False)
con = DelaunayEdges(Points=merge, Plane=PlaneXY(0, 0, 0))  # -> Connectivity, Edges
merge_2 = Merge(Data1=voronoi, Data2=con.Edges)
preview = CustomPreview(Geometry=merge, Shader=ColourSwatch(SwatchColor=RGB(0, 0, 0)))
preview_2 = CustomPreview(Geometry=voronoi, Shader=ColourSwatch(SwatchColor=RGB(46, 38, 32)))
preview_3 = CustomPreview(Geometry=con.Edges, Shader=ColourSwatch(SwatchColor=RGB(138, 74, 74)))
explode = Explode(Curve=merge_2, Recursive=True)  # -> flatten(Segments), Vertices
panel = Panel("15")  # disabled
lng = ListLength(List=explode.Segments)
srf = Surface(<surface referenced from the Rhino model>)  # disabled
panel_2 = Panel(lng)
bnd = Bounds(Numbers=merge_2)  # disabled
boxrec = BoxRectangle(Rectangle=srf, Height=panel)  # disabled
bbox = BoundingBox(Content=merge_2, Plane=PlaneXY(0, 0, 0))  # -> Box, Box_2; disabled
boundary = BoundarySurfaces(Edges=merge_2)  # disabled
panel_3 = Panel(bnd)  # disabled

del = DelaunayMesh(Points=merge, Plane=PlaneXY(0, 0, 0))
faceb = FaceBoundaries(Mesh=del)

# ---- group: constructing a domain based on the wood thickness
number_slider_2 = Slider(2, range=0..15)
number_slider_3 = Slider(14.5, range=0..15)
len = Length(Curve=faceb)
number_slider_4 = Slider(9, range=0..100)
number_slider_5 = Slider(37, range=0..100)
normal = ListNormalizer(Numbers=len)
graph = GraphMapper(
    normal,
    x0=0,
    x1=1,
    y0=0,
    y1=1,
    container_name="Bezier",
    cpx=[0, 0.3797112107, 0.06666631252, 1],
    cpy=[0, 0.2565219402, 0.9463766217, 1])
bnd_2 = Bounds(Numbers=graph)
dom = ConstructDomain(DomainStart=number_slider_4, DomainEnd=number_slider_5)
remap = RemapNumbers(Value=graph, Source=Domain(0, 1), Target=dom)  # -> Mapped, Clipped

# ---- group: smooth outcome
mesh = Mesh(del)
m_vel = ConnectedEdgeLengths(M=del, O=0)  # -> out, G, A, V, T, P; inputs M: Mesh
# ---------- m_vel: VB ----------
    Component.Params.Input(0).Name = "Mesh"
    Component.Params.Input(0).Description = "Open or closed mesh"
    Component.Params.Input(1).Name = "Mode"
    Component.Params.Input(1).Description = "Designates which edge length to check against (0 = Average, 1 = Min, 2 = Max)"
    Component.Params.Input(2).Name = "Length Domain"
    Component.Params.Input(2).Description = "The domain that describes the range of lengths to be tested against"

    Component.Params.Output(1).Name = "Preview Mesh"
    Component.Params.Output(1).Description = "A greyscale preview mesh reflecting the range of values"
    Component.Params.Output(2).Name = "Lengths"
    Component.Params.Output(2).Description = "The length from a vertex to all its connected vertices as specified by the Mode input"
    Component.Params.Output(3).Name = "Values"
    Component.Params.Output(3).Description = "The list of all associated values to each sample point"
    Component.Params.Output(4).Name = "Topology"
    Component.Params.Output(4).Description = "The list of index values connected to the sample point"
    Component.Params.Output(5).Name = "Pattern"
    Component.Params.Output(5).Description = "If the R input is used, the status of each sample point relative to the provided range (0 = Below, 1 = Within, 2 = Above)"

    If M IsNot Nothing Then
      Dim i,j,k As Integer

      Dim iP As Grasshopper.Kernel.IGH_Param = Component.Params.Input(0)
      Dim cP As Grasshopper.Kernel.Data.IGH_Structure = iP.VolatileData

      Dim mf As Rhino.Geometry.Collections.MeshFaceList = Nothing
      Dim mv As Rhino.Geometry.Collections.MeshVertexList = Nothing
      Dim mtv As Rhino.Geometry.Collections.MeshTopologyVertexList = Nothing
      Dim mte As Rhino.Geometry.Collections.MeshTopologyEdgeList = Nothing
      Dim mn As Rhino.Geometry.Collections.MeshVertexNormalList = Nothing
      Dim mc As Rhino.Geometry.Collections.MeshVertexColorList = Nothing

      mf = m.Faces
      mv = m.Vertices
      mtv = m.TopologyVertices
      mte = m.TopologyEdges
      mn = m.Normals
      mc = m.VertexColors

      Dim avgV As New list(Of Double)
      Dim arrVal As New datatree(Of Double)
      Dim arrTop As New datatree(Of Integer)
      Dim oc As New list(Of color)
      Dim tv As Integer
      Dim aMin, aMax As Double
      Dim arrPat As New list(Of Integer)

      For i = 0 To mv.count() - 1 Step 1
        Dim tcv() As Integer
        tcv = mv.GetConnectedVertices(i)

        k = 0
        Dim tdis,sumD, tMin, tMax As New Double
        Dim tarv() As Integer
        ReDim tarv(ubound(tcv))
        For j = 0 To ubound(tcv) Step 1
          tdis = mv.item(i).distanceto(mv.item(tcv(j)))
          If tdis <> 0 Then

            arrVal.add(tDis, cp.Path(Component.RunCount - 1).AppendElement(i))
            arrTop.add(mte.GetEdgeIndex(mtv.TopologyVertexIndex(i), mtv.TopologyVertexIndex(tcv(j))), cp.Path(Component.RunCount - 1).AppendElement(i))
            sumD += tdis
            If j = 0 Then tMin = tdis Else If tdis < tMin Then tMin = tdis
            If tdis > tMax Then tMax = tdis
            K += 1
          End If
        Next

        If O = 1 Then
          sumD = tMin
        ElseIf O = 2 Then
          sumD = tMax
        Else
          sumD /= k
        End If

        If i = 0 Then Amin = sumD Else If sumD < Amin Then Amin = sumD
        If sumD > Amax Then Amax = sumD
        avgV.add(sumD)
      Next

      If R = Nothing Then
        R.t0 = Amin
        R.t1 = Amax
      End If

      For i = 0 To mv.count() - 1 Step 1

        If avgV.item(i) < R.T0 Then
          oc.add(color.FromArgb(0, 0, 255))
          arrPat.add(0)
        ElseIf ((avgV.item(i) > R.T1) Or ((R.t0 = 0) And (R.t1 = 0))) Then
          oc.add(color.FromArgb(255, 0, 0))
          arrPat.add(2)
        Else
          tv = math.Floor((avgV.item(i) - R.T0) / (R.t1 - R.t0) * 255)
          oc.add(color.FromArgb(tv, tv, tv))
          arrPat.add(1)
        End If
      Next

      Dim mo As New mesh
      mo.vertices.AddVertices(mv)
      mo.Faces.AddFaces(mf)
      mo.VertexColors.AppendColors(oc.toarray())

      G = mo
      V = arrVal
      A = avgV
      P = arrPat
      T = arrTop
    End If
# ---------- end m_vel ----------
demesh = DeconstructMesh(Mesh=mesh)  # -> Vertices, Faces, Colours, Normals
number_slider_6 = Slider(1, range=0..15)
number_slider_7 = Slider(14.5, range=0..15)
normal_2 = ListNormalizer(Numbers=m_vel.A)
graph_2 = GraphMapper(
    normal_2,
    x0=0,
    x1=1,
    y0=0,
    y1=1,
    container_name="Bezier",
    cpx=[0, 0.4649357498, 0.3304354846, 1],
    cpy=[0, 0.105268836, 0.8797103167, 1])
bnd_3 = Bounds(Numbers=graph_2)
dom_2 = ConstructDomain(DomainStart=number_slider_4, DomainEnd=number_slider_5)
remap_2 = RemapNumbers(Value=graph_2, Source=Domain(0, 1), Target=dom_2)  # -> Mapped, Clipped
Z = UnitZ(Factor=remap_2.Mapped)
move = Move(Geometry=demesh.Vertices, Motion=Z)  # -> Geometry, Transform
conmesh = ConstructMesh(Vertices=move.Geometry, Faces=demesh.Faces)

# ----
explode_2 = MeshExplode(Mesh=del, Interpolate=False)
demesh_2 = DeconstructMesh(Mesh=explode_2)  # -> Vertices, Faces, Colours, Normals
conmesh_2 = ConstructMesh(Vertices=demesh_2.Vertices, Faces=demesh_2.Faces)
boundary_2 = BoundarySurfaces(Edges=faceb)  # disabled
toggle = BooleanToggle(True)
Z_2 = UnitZ(Factor=remap.Mapped)  # disabled

# ---- group: culling pattern based on area
area = Area(Geometry=conmesh_2)  # -> Area, Centroid
larger = LargerThan(FirstNumber=area.Area, SecondNumber=Slider(500, range=0..10000))  # -> LargerThan, OrEqualTo
cull = CullPattern(List=conmesh_2, CullPattern=larger.LargerThan)

# ---- group: culling patterns based on area
area_2 = Area(Geometry=conmesh_2)  # -> Area, Centroid
smaller = SmallerThan(FirstNumber=area_2.Area, SecondNumber=Slider(500, range=0..10000))  # -> SmallerThan, OrEqualTo
cull_2 = CullPattern(List=conmesh_2, CullPattern=smaller.SmallerThan)

# ----
extr = Extrude(Base=boundary_2, Direction=Z_2)  # disabled
m_offset_extrude = MeshOffsetExtrude(M=graft(conmesh_2), B=False, E=toggle, C0=toggle, C1=True, D=graft(remap.Mapped))  # -> out, flatten(A); inputs M: Mesh, V: list of Vector3d, D: list
# ---------- m_offset_extrude: VB ----------
    Component.Params.Input(0).Name = "Mesh"
    Component.Params.Input(0).Description = "Open or closed mesh"
    Component.Params.Input(1).Name = "Both Sides"
    Component.Params.Input(1).Description = "If true the mesh is offset in both directions along the vertex normals"
    Component.Params.Input(2).Name = "Edges"
    Component.Params.Input(2).Description = "If true the mesh will contain faces on the edges between the two offset mesh faces"
    Component.Params.Input(3).Name = "Closed Bottom"
    Component.Params.Input(3).Description = "If true the mesh will be closed on the origin face"
    Component.Params.Input(4).Name = "Closed Top"
    Component.Params.Input(4).Description = "If true the mesh will be closed on the offset face"
    Component.Params.Input(5).Name = "Vector [Vertex]"
    Component.Params.Input(5).Description = "An optional vector that sets the direction of extrusion, if empty, the new mesh will be offset along the vertex normals"
    Component.Params.Input(6).Name = "Distance [Vertex, Rh Units]"
    Component.Params.Input(6).Description = "A single number or list of numbers corresponding to each vertex of a mesh which sets the Rhino unit based distance that the new geometry is offset from each mesh face"

    Component.Params.Output(1).Name = "Mesh"
    Component.Params.Output(1).Description = "If successful, a valid mesh"

    If m IsNot Nothing Then

      Dim mf As Rhino.Geometry.Collections.MeshFaceList = Nothing
      Dim mv As Rhino.Geometry.Collections.MeshVertexList = Nothing
      Dim mtv As Rhino.Geometry.Collections.MeshTopologyVertexList = Nothing
      Dim mte As Rhino.Geometry.Collections.MeshTopologyEdgeList = Nothing
      Dim mn As Rhino.Geometry.Collections.MeshVertexNormalList = Nothing
      Dim mc As Rhino.Geometry.Collections.MeshVertexColorList = Nothing

      mf = m.Faces
      mv = m.Vertices
      mtv = m.TopologyVertices
      mte = m.TopologyEdges
      mn = m.Normals
      mc = m.VertexColors

      Dim clrB As Boolean = False
      If mc.count() > 0 Then clrB = True

      Dim i,cv,cf,u(1),hd As Integer
      Dim blnV As Boolean
      Dim vec As vector3d
      Dim ova, ovb As New list(Of point3d)
      Dim vf As New list(Of Vector3f)
      Dim ofc As New list(Of MeshFace)
      If b Then hd = 2 Else hd = 1
      
      cv = mv.count()
      cf = mf.count()

      If (D.count() - 1) < cv Then D = matchDbl(D, cv)

      If v.count() > 0 Then
        blnV = True
        If (V.count() - 1) < cv Then V = matchVec(V, cv)
      End If

      'Define Base Vertices
      For i = 0 To cv - 1 Step 1
        If blnV Then vec = V(i) Else vec = mn(i)
        vec.Unitize()
        vec *= (D(i) / hd)

        ovb.add(New point3d(mv(i)) + vec)
        If Not b Then vec *= 0
        vec.Reverse()
        ova.add(New point3d(mv(i)) + vec)
      Next

      If (c0 Or (((Not c0) And (Not e)) And c1)) Then ofc = mf.ToList()

      If ((e or c0) And c1) Then
        For i = 0 To cf - 1 Step 1
          If mf(i).isquad() Then
            ofc.add(New meshface(mf(i).A + cv, mf(i).B + cv, mf(i).C + cv, mf(i).D + cv))
          Else
            ofc.add(New meshface(mf(i).A + cv, mf(i).B + cv, mf(i).C + cv))
          End If
        Next
      End If

      If e Then
        For i = 0 To mte.count() - 1 Step 1

          u(0) = mtv.MeshVertexIndices(mte.GetTopologyVertices(i).I)(0)
          u(1) = mtv.MeshVertexIndices(mte.GetTopologyVertices(i).J)(0)

          If uBound(mte.GetConnectedFaces(i)) < 1 Then
            ofc.add(New meshface(u(0), u(1), u(1) + cv, u(0) + cv))
          End If
        Next
      End If

      Dim mo As New mesh

      If (c0 Or e) Then
        mo.Vertices.AddVertices(ova.toarray())
        If clrB Then mo.VertexColors.AppendColors(mc.ToArray())
      End If
      If (c1 Or e) Then
        mo.Vertices.AddVertices(ovb.toarray())
        If clrB Then mo.VertexColors.AppendColors(mc.ToArray())
      End If

      mo.Faces.AddFaces(ofc)

      A = mo
    End If
# ---------- m_offset_extrude: VB additional code ----------
  Private Function matchDbl(ByVal a As list(Of Double), ByVal t As Integer)
    Dim i,k As Integer
    k = a.count()
    For i = 0 To ((t + 1) - k) - 1 Step 1
      a.add(a.item(k - 1))
    Next
    Return a
  End Function

  Private Function matchVec(ByVal a As list(Of vector3d), ByVal t As Integer)
    Dim i,k As Integer
    k = a.count()
    For i = 0 To ((t + 1) - k) - 1 Step 1
      a.add(a.item(k - 1))
    Next
    Return a
  End Function
# ---------- end m_offset_extrude ----------
m_stellate_0 = Stellate0(G=graft(cull), D=graft(remap.Mapped))  # -> out, A; inputs G: GeometryBase, I: list, D: list, clr: list of Color
# ---------- m_stellate_0: VB ----------
    Component.Params.Input(0).Name = "Mesh or Curve"
    Component.Params.Input(0).Description = "Open or closed mesh or curve"
    Component.Params.Input(1).Name = "Index [Face]"
    Component.Params.Input(1).Description = "An optional integer or list of integers which specify the faces to be modified if the input is a mesh. If no value is supplied then all faces will be modified"
    Component.Params.Input(2).Name = "Distance"
    Component.Params.Input(2).Description = "Sets the depth for the center point offset of each face"
    Component.Params.Input(3).Name = "Color [Vertex]"
    Component.Params.Input(3).Description = "(If applied to a mesh a list of colors corresponding to each mesh face, if applied to a curve, a list of colors corresponding to each control point plus an additonal color value for the new averaged center"

    Component.Params.Output(1).Name = "Mesh"
    Component.Params.Output(1).Description = "If successful, a valid mesh"

    If G IsNot Nothing Then

      Dim bM, bP,bmC,biC As Boolean

      bM = g.ObjectType = ObjectType.Mesh
      bP = g.ObjectType = ObjectType.Curve

      If (bM Or bP) Then
        Dim msh As New mesh
        Dim crv As curve
        Dim av As point3d
        Dim ac As color
        Dim h,j,jj,k,u,v,w As Integer
        Dim cv,cf As Integer
        Dim x(),y() As Integer

        Dim mv,fv,tv As New list(Of Point3d)
        Dim mev As New dictionary(Of String, Integer)
        Dim mf As Rhino.Geometry.Collections.MeshFaceList = Nothing
        Dim mtv As Rhino.Geometry.Collections.MeshTopologyVertexList = Nothing
        Dim mn As Rhino.Geometry.Collections.MeshVertexNormalList = Nothing
        Dim mfn As Rhino.Geometry.Collections.MeshFaceNormalList = Nothing
        Dim ev As New list(Of vector3d)
        Dim ed,en As New list(Of Double)
        Dim mc,tc,cc,fc As New list(Of color)
        Dim xf As New list(Of meshface)

        If clr.count() = 0 Then clr.add(color.LightGray) Else biC = True

        If bm Then
          'Start Deconstruct if Mesh
          msh = g

          If msh.Normals.Count() = 0 Then msh.Normals.ComputeNormals()
          If msh.FaceNormals.Count() = 0 Then msh.FaceNormals.ComputeFaceNormals()

          If i.count() = 0 Then I = Enumerable.Range(0, msh.Faces.Count()).ToList()

          mv = msh.Vertices().ToPoint3dArray().tolist()
          mtv = msh.TopologyVertices()
          mf = msh.Faces()

          mn = msh.Normals()
          mn.UnitizeNormals()
          mfn = msh.FaceNormals()
          mfn.UnitizeFaceNormals()

          cf = I.Count() - 1

          'Assign Colors
          If msh.VertexColors.Count() = 0  Then
            msh.VertexColors.CreateMonotoneMesh(color.LightGray)
            bmC = biC
          Else
            bmC = True
          End If
          'Assign fake edges
          mc = msh.VertexColors().ToArray().ToList()
        Else
          'Start Deconstruct if Curve
          crv = g

          I.clear()
          I.add(0)
          Dim nc As nurbscurve
          Dim pc As polyline
          Dim nps As Rhino.Geometry.Collections.NurbsCurvePointList

          nc = crv.ToNurbsCurve()
          nps = nc.Points
          pc = nc.Points.ControlPolygon
          If (Not pc.IsClosed) Then pc.add(pc(0))
          av = pc.CenterPoint

          msh.Vertices.AddVertices(pc.ToArray())
          msh.faces.addfaces(pc.TriangulateClosedPolyline())
          msh.Vertices.Remove(pc.count() - 1, True)
          msh.FaceNormals.ComputeFaceNormals()
          msh.Normals.ComputeNormals()
          msh.Normals.UnitizeNormals()

          mv = msh.Vertices.ToPoint3dArray().tolist()
          mtv = msh.TopologyVertices()
          mn = msh.Normals()
          mfn = msh.FaceNormals()

          mfn(0) = avgVec(mn.toarray())

          'Assign Colors
          If bic Then bmC = True
          mc = clr
          If (clr.count() - 1) < (mv.count() - 1) Then mc = matchClr(mc, mv.count() - 1)

          ac = avgClr(mc.toarray())
          cf = 0
        End If
        cv = mv.count() - 1

        x = appendprepend(cv)
        'Match variables and colors to vertex count
        If (D.count() - 1) < cv Then D = matchDbl(D, cv)
        If (clr.count() - 1) < cv Then clr = matchClr(clr, cv)
        If biC Then fc = clr Else fc = mc

        'Face based vertices
        Dim xv(),mt(),ei() As Integer
        Dim xc() As color
        Dim xd,xn As Double
        ReDim ei(3)
        u = 1
        v = cf + 1 + mv.count()

        For jj = 0 To I.count() - 1 Step 1
          Dim tcv As New point3d
          j = I(jj)
          w = v + tv.count()
          xd = 0
          xn = 0
          If bm Then
            If mf(j).isquad() Then h = 4 Else h = 3
            ReDim xv(h - 1)
            ReDim xc(h - 1)
            mt = mf.GetTopologicalVertices(j)
            For k = 0 To h - 1 Step 1
              xv(k) = mtv.MeshVertexIndices(mt(k))(0)
              xc(k) = fc(xv(k))
            Next
            av = mf.GetFaceCenter(j)
            ac = avgClr(xc)
          Else
            h = mv.count()
            xv = Enumerable.Range(0, h).ToArray()
          End If
          For k = 0 To h - 1 Step 1
            xd += D(xv(k))
          Next
          xd /= h
          mfn(j) *= xd
          y = appendprepend(h - 1)

          For k = 1 To h Step 1
            'Define new faces
            xf.add(New meshface(xv(y(k + 1)), v + jj - cf - 1, xv(y(k))))
          Next
          fv.add(av + mfn(j))
          cc.add(ac)
        Next

        Dim om As New mesh

        om.Vertices.AddVertices(mv)
        If bmC Then om.VertexColors.AppendColors(mc.toarray())
        om.Vertices.AddVertices(fv)
        If bmC Then om.VertexColors.AppendColors(cc.toarray())

        om.Faces.AddFaces(xf.toarray())

        If i.count() > 1 Then om.Vertices.CullUnused()

        A = om
      End If
    End If
# ---------- m_stellate_0: VB additional code ----------
  Private Function appendprepend(ByVal i As Integer)
    Dim srsEnum As IEnumerable(Of Integer) = Enumerable.Range(0, i + 1)
    Dim arrVal As New list(Of Integer)
    arrVal = srsEnum.tolist()
    arrVal.add(0)
    arrVal.insert(0, i)
    Return arrVal.toarray()
  End Function

  Private Function matchDbl(ByVal a As list(Of Double), ByVal t As Integer)
    Dim i,k As Integer
    k = a.count()
    For i = 0 To ((t + 1) - k) - 1 Step 1
      a.add(a.item(k - 1))
    Next
    Return a
  End Function

  Private Function matchClr(ByVal a As list(Of Color), ByVal t As Integer)
    Dim i,k As Integer
    k = a.count()
    For i = 0 To ((t + 1) - k) - 1 Step 1
      a.add(a.item(k - 1))
    Next
    Return a
  End Function

  Private Function evalP(ByVal op As point3d, ByVal tp As Point3d, ByVal t As Double)
    Return New point3d(op + (tp - op) * t)
  End Function

  Private Function evalV(ByVal ov As vector3d, ByVal tv As vector3d, ByVal t As Double)
    Return New vector3d(ov + (tv - ov) * t)
  End Function

  Private Function evalN(ByVal u As Double, ByVal v As Double, ByVal t As Double)
    Return u + (v - u) * t
  End Function

  Private Function avgVec(ByVal v() As vector3f)
    Dim i As Integer
    Dim tv As Vector3d

    For i = 0 To ubound(v) Step 1
      tv += v(i)
    Next
    tv /= (ubound(v) + 1)
    tv.Unitize()
    Return New vector3f(tv.X, tv.Y, tv.Z)
  End Function

  Private Function roundClr(ByVal r As Integer, ByVal g As Integer, ByVal b As Integer, ByVal i As Integer)
    r = CInt(r / i)
    g = CInt(g / i)
    b = CInt(b / i)

    If r > 255 Then r = 255 Else If r < 0 Then r = 0
    If g > 255 Then g = 255 Else If g < 0 Then g = 0
    If b > 255 Then b = 255 Else If b < 0 Then b = 0

    Return color.FromArgb(r, g, b)
  End Function

  Private Function avgClr(ByVal c() As color)
    Dim r,g,b As Integer
    Dim i,k As Integer

    k = ubound(c) + 1

    For i = 0 To k - 1 Step 1
      r += CInt(c(i).R)
      g += CInt(c(i).G)
      b += CInt(c(i).B)
    Next

    r = CInt(r / k)
    g = CInt(g / k)
    b = CInt(b / k)

    If r > 255 Then r = 255 Else If r < 0 Then r = 0
    If g > 255 Then g = 255 Else If g < 0 Then g = 0
    If b > 255 Then b = 255 Else If b < 0 Then b = 0

    Return color.FromArgb(r, g, b)
  End Function

  Private Function evalC(ByVal oc As color, ByVal tc As color, ByVal t As Double)
    Dim r,g,b As Integer
    r = CInt(CInt(oc.R) + (CInt(tc.R) - CInt(oc.R)) * t)
    g = CInt(CInt(oc.G) + (CInt(tc.G) - CInt(oc.G)) * t)
    b = CInt(CInt(oc.B) + (CInt(tc.B) - CInt(oc.B)) * t)

    If r > 255 Then r = 255 Else If r < 0 Then r = 0
    If g > 255 Then g = 255 Else If g < 0 Then g = 0
    If b > 255 Then b = 255 Else If b < 0 Then b = 0

    Return color.FromArgb(r, g, b)
  End Function
# ---------- end m_stellate_0 ----------
m_frame_0 = Frame0(G=cull_2, T0=Slider(0.5, range=0..1), D=Slider(2, range=-1..11), N=1, S=1, O=Toggle(True))  # -> out, A; inputs G: GeometryBase, I: list, T0: list, D: list, N: list, S: list, clr: list of Color
# ---------- m_frame_0: VB ----------
    Component.Params.Input(0).Name = "Mesh or Curve"
    Component.Params.Input(0).Description = "Open or closed mesh or curve"
    Component.Params.Input(1).Name = "Index [Face]"
    Component.Params.Input(1).Description = "An optional integer or list of integers which specify the faces to be modified if the input is a mesh. If no value is supplied then all faces will be modified"
    Component.Params.Input(2).Name = "Vert to Face"
    Component.Params.Input(2).Description = "Evaluates a new vertex between the input geometry's vertex to the face center"
    Component.Params.Input(3).Name = "Distance"
    Component.Params.Input(3).Description = "Sets the depth for the center point offset of each face"
    Component.Params.Input(4).Name = "Normalize"
    Component.Params.Input(4).Description = "If true averages the vertex values per face, if false each new vertices parameters are associated to its origin vertex"
    Component.Params.Input(5).Name = "Stellate"
    Component.Params.Input(5).Description =  "A unitized per vertex number which shifts the offset vector from vertex = 0 to face = 1 normal"
    Component.Params.Input(6).Name = "Close"
    Component.Params.Input(6).Description = "If true then additional faces and if needed vertices will be added to the mesh, covering the complete areas of the existing mesh"
    Component.Params.Input(7).Name = "Optimize"
    Component.Params.Input(7).Description = "If true, when faces are quad or tri based, a single face will be used about the face center, if false or per face vertex count is greater than 4 then a new offset vertex is added"
    Component.Params.Input(8).Name = "Color [Vertex]"
    Component.Params.Input(8).Description = "(If applied to a mesh a list of colors corresponding to each mesh face, if applied to a curve, a list of colors corresponding to each control point plus an additonal color value for the new averaged center"

    Component.Params.Output(1).Name = "Mesh"
    Component.Params.Output(1).Description = "If successful, a valid mesh"

    If G IsNot Nothing Then

      Dim bM, bP,bmC,biC As Boolean

      bM = g.ObjectType = ObjectType.Mesh
      bP = g.ObjectType = ObjectType.Curve

      If (bM Or bP) Then
        Dim msh As New mesh
        Dim crv As curve
        Dim av As point3d
        Dim ac As color
        Dim h,j,jj,k,u,v,w As Integer
        Dim cv,cf As Integer
        Dim x(),y() As Integer

        Dim mv,fv,ev,tv As New list(Of Point3d)
        Dim mf As Rhino.Geometry.Collections.MeshFaceList = Nothing
        Dim mtv As Rhino.Geometry.Collections.MeshTopologyVertexList = Nothing
        Dim mte As Rhino.Geometry.Collections.MeshTopologyEdgeList = Nothing
        Dim mn As Rhino.Geometry.Collections.MeshVertexNormalList = Nothing
        Dim mfn As Rhino.Geometry.Collections.MeshFaceNormalList = Nothing
        Dim mc,tc,cc,fc As New list(Of color)
        Dim xf As New list(Of meshface)

        If clr.count() = 0 Then clr.add(color.LightGray) Else biC = True

        If bm Then
          'Start Deconstruct if Mesh
          msh = g

          If msh.Normals.Count() = 0 Then msh.Normals.ComputeNormals()
          If msh.FaceNormals.Count() = 0 Then msh.FaceNormals.ComputeFaceNormals()

          If i.count() = 0 Then I = Enumerable.Range(0, msh.Faces.Count()).ToList()

          mv = msh.Vertices().ToPoint3dArray().tolist()
          mtv = msh.TopologyVertices()
          mf = msh.Faces()

          mn = msh.Normals()
          mn.UnitizeNormals()
          mfn = msh.FaceNormals()
          mfn.UnitizeFaceNormals()

          cf = I.Count() - 1

          'Assign Colors
          If msh.VertexColors.Count() = 0 Then
            msh.VertexColors.CreateMonotoneMesh(color.LightGray)
            bmC = biC
          Else
            bmC = True
          End If
          'Assign fake edges
          mc = msh.VertexColors().ToArray().ToList()
        Else
          'Start Deconstruct if Curve
          crv = g

          I.clear()
          I.add(0)
          Dim nc As nurbscurve
          Dim pc As polyline
          Dim nps As Rhino.Geometry.Collections.NurbsCurvePointList

          nc = crv.ToNurbsCurve()
          nps = nc.Points
          pc = nc.Points.ControlPolygon
          If (Not pc.IsClosed) Then pc.add(pc(0))
          av = pc.CenterPoint

          msh.Vertices.AddVertices(pc.ToArray())
          msh.faces.addfaces(pc.TriangulateClosedPolyline())
          msh.Vertices.Remove(pc.count() - 1, True)
          msh.FaceNormals.ComputeFaceNormals()
          msh.Normals.ComputeNormals()
          msh.Normals.UnitizeNormals()

          mv = msh.Vertices.ToPoint3dArray().tolist()
          mtv = msh.TopologyVertices()
          mn = msh.Normals()
          mfn = msh.FaceNormals()

          mfn(0) = avgVec(mn.toarray())

          'Assign Colors
          If bic Then bmC = True
          mc = clr
          If (clr.count() - 1) < (mv.count() - 1) Then mc = matchClr(mc, mv.count() - 1)


          ac = avgClr(mc.toarray())
          If (mv.count() - 1) > 3 Then o = False
          cf = 0
        End If
        cv = mv.count() - 1

        x = appendprepend(cv)
        'Match variables and colors to vertex count
        If (T0.count() - 1) < cv Then T0 = matchDbl(T0, cv)
        If (D.count() - 1) < cv Then D = matchDbl(D, cv)
        If (N.count() - 1) < cv Then N = matchDbl(N, cv)
        If (S.count() - 1) < cv Then S = matchDbl(S, cv)
        If (clr.count() - 1) < cv Then clr = matchClr(clr, cv)
        If biC Then fc = clr Else fc = mc

        'Face based vertices
        Dim xv(),mt() As Integer
        Dim xc() As color
        Dim xd,xn As Double
        Dim txv(0) As vector3d
        u = 1
        v = mv.count()
        If (c And (o = False)) Then v += cf + 1

        For jj = 0 To I.count() - 1 Step 1
          Dim tcv As New point3d
          j = I(jj)
          w = v + tv.count()
          xd = 0
          xn = 0
          If bm Then
            If mf(j).isquad() Then h = 4 Else h = 3
            ReDim xv(h - 1)
            ReDim xc(h - 1)
            mt = mf.GetTopologicalVertices(j)
            For k = 0 To h - 1 Step 1
              xv(k) = mtv.MeshVertexIndices(mt(k))(0)
              xc(k) = fc(xv(k))
            Next
            av = mf.GetFaceCenter(j)
            ac = avgClr(xc)
          Else
            h = mv.count()
            xv = Enumerable.Range(0, h).ToArray()
          End If
          For k = 0 To h - 1 Step 1
            xd += D(xv(k))
            xn += T0(xv(k))
          Next
          xd /= h
          xn /= h
          mfn(j) *= xd
          y = appendprepend(h - 1)

          For k = 1 To h Step 1
            txv(0) = mN(xv(y(k))) * evalN(D(xv(y(k))) * t0(xv(y(k))), xd * xn, N(xv(y(k))))
            'Define new per face vertices
            tv.add(evalP(mv(xv(y(k))) + txv(0), evalP(mv(xv(y(k))), av + evalV(txv(0), mfn(j), t0(xv(y(k)))), t0(xv(y(k)))), S(xv(y(k)))))
            tc.add(evalC(mc(xv(y(k))), ac, t0(xv(y(k)))))
            tcv += tv.item(tv.count() - 1)

            'Define new faces
            xf.add(New meshface(xv(y(k)), xv(y(k + 1)), w + y(k + 1) * u, w + y(k) * u))

            If (c And (o = False))Then
              xf.add(New meshface(w + y(k + 1) * u, v + jj - cf - 1, w + y(k) * u))
            End If
          Next
          If (c And o)Then
            If h = 3 Then
              xf.add(New meshface(w + 0 * u, w + 1 * u, w + 2 * u))
            ElseIf h = 4 Then
              xf.add(New meshface(w + 0 * u, w + 1 * u, w + 2 * u, w + 3 * u))
            End If
          Else
            tcv /= h
            fv.add(tcv)
            cc.add(ac)
          End If
        Next

        Dim om As New mesh
        om.Vertices.AddVertices(mv)
        If bmC Then om.VertexColors.AppendColors(mc.toarray())

        If c Then
          om.Vertices.AddVertices(fv)
          If bmC Then om.VertexColors.AppendColors(cc.toarray())
        End If

        om.Vertices.AddVertices(tv.toarray())
        If bmC Then om.VertexColors.AppendColors(tc.toarray())

        om.Faces.AddFaces(xf.toarray())
        If i.count() > 0 Then om.Vertices.CullUnused()

        If i.count() > 1 Then om.Vertices.CullUnused()

        A = om
      End If
    End If
# ---------- m_frame_0: VB additional code ----------
  Private Function appendprepend(ByVal i As Integer)
    Dim srsEnum As IEnumerable(Of Integer) = Enumerable.Range(0, i + 1)
    Dim arrVal As New list(Of Integer)
    arrVal = srsEnum.tolist()
    arrVal.add(0)
    arrVal.insert(0, i)
    Return arrVal.toarray()
  End Function

  Private Function matchDbl(ByVal a As list(Of Double), ByVal t As Integer)
    Dim i,k As Integer
    k = a.count()
    For i = 0 To ((t + 1) - k) - 1 Step 1
      a.add(a.item(k - 1))
    Next
    Return a
  End Function

  Private Function matchClr(ByVal a As list(Of Color), ByVal t As Integer)
    Dim i,k As Integer
    k = a.count()
    For i = 0 To ((t + 1) - k) - 1 Step 1
      a.add(a.item(k - 1))
    Next
    Return a
  End Function

  Private Function evalP(ByVal op As point3d, ByVal tp As Point3d, ByVal t As Double)
    Return New point3d(op + (tp - op) * t)
  End Function

  Private Function evalV(ByVal ov As vector3d, ByVal tv As vector3d, ByVal t As Double)
    Return New vector3d(ov + (tv - ov) * t)
  End Function

  Private Function evalN(ByVal u As Double, ByVal v As Double, ByVal t As Double)
    Return u + (v - u) * t
  End Function

  Private Function avgVec(ByVal v() As vector3f)
    Dim i As Integer
    Dim tv As Vector3d

    For i = 0 To ubound(v) Step 1
      tv += v(i)
    Next
    tv /= (ubound(v) + 1)
    tv.Unitize()
    Return New vector3f(tv.X, tv.Y, tv.Z)
  End Function

  Private Function roundClr(ByVal r As Integer, ByVal g As Integer, ByVal b As Integer, ByVal i As Integer)
    r = CInt(r / i)
    g = CInt(g / i)
    b = CInt(b / i)

    If r > 255 Then r = 255 Else If r < 0 Then r = 0
    If g > 255 Then g = 255 Else If g < 0 Then g = 0
    If b > 255 Then b = 255 Else If b < 0 Then b = 0

    Return color.FromArgb(r, g, b)
  End Function

  Private Function avgClr(ByVal c() As color)
    Dim r,g,b As Integer
    Dim i,k As Integer

    k = ubound(c) + 1

    For i = 0 To k - 1 Step 1
      r += CInt(c(i).R)
      g += CInt(c(i).G)
      b += CInt(c(i).B)
    Next

    r = CInt(r / k)
    g = CInt(g / k)
    b = CInt(b / k)

    If r > 255 Then r = 255 Else If r < 0 Then r = 0
    If g > 255 Then g = 255 Else If g < 0 Then g = 0
    If b > 255 Then b = 255 Else If b < 0 Then b = 0

    Return color.FromArgb(r, g, b)
  End Function

  Private Function evalC(ByVal oc As color, ByVal tc As color, ByVal t As Double)
    Dim r,g,b As Integer
    r = CInt(CInt(oc.R) + (CInt(tc.R) - CInt(oc.R)) * t)
    g = CInt(CInt(oc.G) + (CInt(tc.G) - CInt(oc.G)) * t)
    b = CInt(CInt(oc.B) + (CInt(tc.B) - CInt(oc.B)) * t)

    If r > 255 Then r = 255 Else If r < 0 Then r = 0
    If g > 255 Then g = 255 Else If g < 0 Then g = 0
    If b > 255 Then b = 255 Else If b < 0 Then b = 0

    Return color.FromArgb(r, g, b)
  End Function
# ---------- end m_frame_0 ----------
mesh_2 = Mesh(m_offset_extrude.A)
merge_3 = Merge(Data1=m_frame_0.A, Data2=m_stellate_0.A)
preview_4 = CustomPreview(Geometry=m_offset_extrude.A, Shader=ColourSwatch(SwatchColor=RGB(135, 135, 135)))
preview_5 = CustomPreview(Geometry=merge_3, Shader=ColourSwatch(SwatchColor=RGB(194, 194, 194)))
mesh_3 = Mesh(merge_3)
